# Grasshopper definition topography+ False color for distinguishing differences in bare earth.gh (Grasshopper 0.9.76)
# plug-ins: MeshEdit Components, RasterGrid, ReadRasterData

panel = Panel("C:\Users\starsky\StealingFired\nero101\data\hongkong\NERO\_NERO101\ASTER GLOBAL DEM\ASTGTM2_N21E113-N21E114-N22E113-N22E114-N23E113-N23E114_newResolution.tif")
panel_2 = Panel("C:\Users\starsky\StealingFired\nero101\data\hongkong\NERO\_NERO101\Landsat 8 OLI-TIRS C1 LEVEL-1\B3.tif")
panel_3 = Panel("C:\Users\starsky\StealingFired\nero101\data\hongkong\NERO\_NERO101\Landsat 8 OLI-TIRS C1 LEVEL-1\B6.tif")
panel_4 = Panel("C:\Users\starsky\StealingFired\nero101\data\hongkong\NERO\_NERO101\Landsat 8 OLI-TIRS C1 LEVEL-1\B2.tif")
toggle = BooleanToggle(True)
pt = ConstructPoint(XCoordinate=0, YCoordinate=0, ZCoordinate=0)
raster = ReadRaster(ImagePath=panel, RunRaster=Toggle(True))  # -> XYSize, ImageDriver, BANDs, Metadata, R
raster_2 = ReadRaster(ImagePath=panel_3, RunRaster=toggle)  # -> XYSize, ImageDriver, BANDs, Metadata, R
raster_3 = ReadRaster(ImagePath=panel_2, RunRaster=toggle)  # -> XYSize, ImageDriver, BANDs, Metadata, R
raster_4 = ReadRaster(ImagePath=panel_4, RunRaster=toggle)  # -> XYSize, ImageDriver, BANDs, Metadata, R
grid = RasterGrid(Localization=pt, XYSize=raster.XYSize)
bnd = Bounds(Numbers=raster_2.R)
bnd_2 = Bounds(Numbers=raster_3.R)
bnd_3 = Bounds(Numbers=raster_4.R)
Z = UnitZ(Factor=raster.R)
dom = ConstructDomain(DomainStart=Slider(0, range=0..255), DomainEnd=Slider(255, range=0..255))
scale_nu = ScaleNU(Geometry=grid, Plane=pt, ScaleX="30.0022", ScaleY="30.008", ScaleZ=1)  # -> Geometry, Transform
number_slider = Slider(10, range=0..10)
remap = RemapNumbers(Value=raster_2.R, Source=bnd, Target=dom)  # -> Mapped, Clipped
remap_2 = RemapNumbers(Value=raster_4.R, Source=bnd_3, Target=dom)  # -> Mapped, Clipped
remap_3 = RemapNumbers(Value=raster_3.R, Source=bnd_2, Target=dom)  # -> Mapped, Clipped
move = Move(Geometry=scale_nu.Geometry, Motion=Z)  # -> Geometry, Transform
multiplication = Multiplication(A=remap.Mapped, B=number_slider)
multiplication_2 = Multiplication(A=remap_2.Mapped, B=number_slider)
multiplication_3 = Multiplication(A=remap_3.Mapped, B=number_slider)
split = TextSplit(Text=raster.XYSize, Separators=",")
rgb = ColourRGB(Alpha=255, Red=multiplication, Green=multiplication_3, Blue=multiplication_2)
item = ListItem(List=split, Index=0, Wrap=True)  # -> Item, Item1
frompoints = MeshFromPoints(Points=move.Geometry, UDirection=item.Item1, VDirection=item.Item, Colour=rgb)
