# Grasshopper definition topography+NDVI.gh (Grasshopper 0.9.76)
# plug-ins: MeshEdit Components, RasterGrid, NDVIColorRange, NDVICalculator, ReadRasterData

panel = Panel("C:\Users\starsky\StealingFired\nero101\data\hongkong\NERO\_NERO101\ASTER GLOBAL DEM\ASTGTM2_N21E113-N21E114-N22E113-N22E114-N23E113-N23E114_newResolution.tif")
panel_2 = Panel("C:\Users\starsky\StealingFired\nero101\data\hongkong\NERO\_NERO101\Landsat 8 OLI-TIRS C1 LEVEL-1\B5.tif")
panel_3 = Panel("C:\Users\starsky\StealingFired\nero101\data\hongkong\NERO\_NERO101\Landsat 8 OLI-TIRS C1 LEVEL-1\B4.tif")
panel_4 = Panel("C:\Users\starsky\StealingFired\nero101\data\hongkong\NERO\_NERO101\Landsat 8 OLI-TIRS C1 LEVEL-1\B4.tif")
toggle = BooleanToggle(True)
pt = ConstructPoint(XCoordinate=0, YCoordinate=0, ZCoordinate=0)
raster = ReadRaster(ImagePath=panel, RunRaster=Toggle(True))  # -> XYSize, ImageDriver, BANDs, Metadata, R
raster_2 = ReadRaster(ImagePath=panel_2, RunRaster=toggle)  # -> XYSize, ImageDriver, BANDs, Metadata, R
raster_3 = ReadRaster(ImagePath=panel_3, RunRaster=toggle)  # -> XYSize, ImageDriver, BANDs, Metadata, R
grid = RasterGrid(Localization=pt, XYSize=raster.XYSize)
multiplication = Multiplication(A=raster_3.R, B=Slider(0.5, range=0..1))
Z = UnitZ(Factor=raster.R)
ndvical = NDVICalculator(NIR=raster_2.R, VIS=multiplication)
dom = ConstructDomain(DomainStart=Slider(50, range=0..255), DomainEnd=Slider(255, range=0..255))
bnd = Bounds(Numbers=raster.R)
scale_nu = ScaleNU(Geometry=grid, Plane=pt, ScaleX="30.0022", ScaleY="30.008", ScaleZ=1)  # -> Geometry, Transform
remap = RemapNumbers(Value=raster.R, Source=bnd, Target=dom)  # -> Mapped, Clipped
ndvicolor = NDVIColorRange(NDVI=ndvical)
move = Move(Geometry=scale_nu.Geometry, Motion=Z)  # -> Geometry, Transform
split = TextSplit(Text=raster.XYSize, Separators=",")
rgb = ColourRGB(Alpha=255, Red=0, Green=0, Blue=remap.Mapped)
col = Colour(ndvicolor)
item = ListItem(List=split, Index=0, Wrap=True)  # -> Item, Item1
frompoints = MeshFromPoints(Points=move.Geometry, UDirection=item.Item1, VDirection=item.Item, Colour=col)
